# Dynamo graph 1-批量生成墙体.dyn "批量生成墙体" (Dynamo 2.19.3.6394)
# packages: bimorphNodes 4.2.4

# group: 输入
# 说明 <双击此处编辑组说明>
选择链接CAD = DSModelElementSelection()  # 1 picked in the model; graph input
墙体的CAD图层 = StringInput("WALL")  # graph input
墙体的底部Revit标高 = Levels("标高 1")  # graph input
墙体的顶部Revit标高 = Levels("标高 2")  # graph input

curvesFromCADLayers = CAD.CurvesFromCADLayers(importInstance=选择链接CAD, layerNames=墙体的CAD图层)
watch = Watch(curvesFromCADLayers.Curve)
python_script = Python(IN[0]=watch, IN[1]=墙体的底部Revit标高, IN[2]=墙体的顶部Revit标高)  # CPython3
# ---------- python_script.python (287 lines) ----------
# -*- coding: utf-8 -*-
# 固定导入内容
# 1. 加载Python Standard和DesignScript库
import sys
import os
import math
import json
import clr

clr.AddReference('ProtoGeometry')  # Dynamo核心几何库
from Autodesk.DesignScript.Geometry import *
import Autodesk.DesignScript.Geometry as DynGeometry # 为避免冲突，使用DynGeometry.XX

clr.AddReference('DSCoreNodes')  # Dynamo核心基础库
import DSCore  # 为避免冲突，使用DSCore.List.XX

clr.AddReference('RevitNodes')  # Dynamo Revit专属节点库
import Revit   # 为避免冲突，使用Revit.Elements.XX
clr.ImportExtensions(Revit.Elements)
clr.ImportExtensions(Revit.GeometryConversion)

# 2. 导入Revit API
clr.AddReference('RevitAPI')
clr.AddReference('RevitAPIUI')
clr.AddReference("System.Collections")
import System
from Autodesk.Revit.DB import *
from Autodesk.Revit.UI import *
from System.Collections.Generic import *

# 3. 导入Revit管理服务
clr.AddReference("RevitServices")
import RevitServices
from RevitServices.Persistence import DocumentManager
from RevitServices.Transactions import TransactionManager

# 4. 全局文档对象
doc = DocumentManager.Instance.CurrentDBDocument
app = doc.Application
uiApp = DocumentManager.Instance.CurrentUIApplication
uidoc = uiApp.ActiveUIDocument

# 该节点的输入内容将存储为 IN 变量中的一个列表。
dataEnteringNode = IN

wall_curves = IN[0]
level_start = IN[1]
level_end = IN[2]

# ==================================================
# 成组相连的曲线
# ==================================================
def _group_curves(curves_list):
    """
    成组相连的线条，可用于多段线
    """
    curves = list(DSCore.List.Flatten(curves_list))
    ignore_distance = 0.1
    grouped_lines = []

    while curves:
        Shape = []
        Queue = [curves.pop()]
        while Queue:
            current_line = Queue.pop(0)
            Shape.append(current_line)
            # 临时存储要加入的曲线，避免循环内重复判断
            add_list = []
            for potential_match in curves:
                p1s = (potential_match.StartPoint, potential_match.EndPoint)
                p2s = (current_line.StartPoint, current_line.EndPoint)
                for p1 in p1s:
                    for p2 in p2s:
                        if p1.DistanceTo(p2) <= ignore_distance:
                            if potential_match not in add_list:
                                add_list.append(potential_match)
                            break
                    else:
                        continue
                    break
            # 批量加入队列
            for crv in add_list:
                if crv not in Queue:
                    Queue.append(crv)
            # 剔除已入队曲线
            curves = [c for c in curves if c not in Queue]
        grouped_lines.append(Shape)
    return grouped_lines

group_curves = _group_curves(wall_curves)
# OUT = group_curves

# 筛选出＜3的组合，后续进行处理
group1 = DSCore.List.Flatten([group for group in group_curves if len(group)<3])
group2 = [group for group in group_curves if len(group)>=3]

# OUT = group1

# ==================================================
# 成组两条平行线
# ==================================================
def _parallel_curves(curves): 
    """
    #成组两条平行线。对于过短的平行线，需要二次筛选
    """
    if len(curves) < 2:
        return []
    
    mid_points = [c.PointAtParameter(0.5) for c in curves]
    distance = [[p.DistanceTo(q) for q in mid_points] for p in mid_points]
    sorted_distance = [DSCore.List.Sort(row) for row in distance]
    match_distance = [row[1] for row in sorted_distance] 

    match_index = []
    for i in range(len(distance)):
        idx = DSCore.List.FirstIndexOf(distance[i], match_distance[i])
        match_index.append(idx)
    
    filter_curves = [DSCore.List.GetItemAtIndex(curves, index) for index in match_index]
    
    curves_list = []
    seen_pairs = set()  # 新增：记录已处理的配对索引，避免重复
    
    for i in range(len(curves)):
        j = match_index[i]
        # 关键修复：只处理 i < j 的情况，确保每对只创建一次
        if i < j and (i, j) not in seen_pairs:
            keys = [curves[i].Length, filter_curves[i].Length]
            lst = [curves[i], filter_curves[i]]
            sorted_lst = DSCore.List.SortByKey(lst, keys)["sortedList"]
            curves_list.append(sorted_lst)
            seen_pairs.add((i, j))  # 记录已处理配对
    
    parallel_curves = DSCore.List.UniqueItems(curves_list)
    return parallel_curves


parallel_curves_original = [_parallel_curves(group) for group in group2]
parallel_curves_plus = _parallel_curves(group1)
# OUT = parallel_curves_plus

# ==================================================
# 二次筛选过短的平行线
# ==================================================
parallel_mask = []

for group in parallel_curves_original:
    pair_mask = []
    for pair in group:
        line_vector1 = pair[0].Direction
        line_vector2 = pair[1].Direction
        mask = line_vector1.IsParallel(line_vector2)
        pair_mask.append(mask)
    parallel_mask.append(pair_mask)


parallel_curves_original = [_parallel_curves(group) for group in group2]
parallel_curves_plus = _parallel_curves(group1)
#OUT = parallel_curves_plus

# ==================================================
# 二次筛选过短的平行线
# ==================================================
parallel_mask = []

for group in parallel_curves_original:
    pair_mask = []
    for pair in group:
        line_vector1 = pair[0].Direction
        line_vector2 = pair[1].Direction
        mask = line_vector1.IsParallel(line_vector2)
        pair_mask.append(mask)
    parallel_mask.append(pair_mask)

#OUT = parallel_mask

parallel_curves = DSCore.List.FilterByBoolMask(parallel_curves_original, parallel_mask)["in"]
second_filter_curves = []
for i in range(len(parallel_curves_original)):
    filter_curves = DSCore.List.FilterByBoolMask(parallel_curves_original[i], parallel_mask[i])["out"]
    second_filter_curves.append(filter_curves)       
#OUT = second_filter_curves

def _get_pair_value(curves_list):
    """
    #二次筛选出成对平行线
    """
    # 1. 收集所有线条，统计出现次数
    lst = list(curves_list)
    all_lines = []
    for a, b in lst:
        all_lines.append(a)
        all_lines.append(b)

    count = {}
    for line in all_lines:
        count[line] = count.get(line, 0) + 1

    # 2. 自动找到出现2次的线条
    repeat_line = None
    for k, v in count.items():
        if v == 2:
            repeat_line = k
            break

    # 3. 提取配对的另一个线条
    res = []
    for a, b in lst:
        if a == repeat_line:
            res.append(b)
        elif b == repeat_line:
            res.append(a)
    return res

# 把二次筛选的平行线添加进原有的平行线中
for i in range(len(parallel_curves)):
    pair_curves = _get_pair_value(second_filter_curves[i])
    if not pair_curves:
        continue
    new_group = DSCore.List.AddItemToEnd(pair_curves, parallel_curves[i])
    parallel_curves[i] = new_group

# 把parallel_curves_plus添加进原有的平行线中
parallel_plus = [[group] for group in parallel_curves_plus]
parallel_curves_all = DSCore.List.Join(parallel_curves, parallel_plus)

#OUT = parallel_curves,parallel_plus,parallel_curves_all

# 求取平行线间距作为墙厚
wall_name = []
for group in parallel_curves_all:
    for i in range(len(group)):
        distance = int(DSCore.Math.Round(group[i][0].DistanceTo(group[i][1])))
        name = str(distance) + "mm"
        wall_name.append(name)
        
# ==================================================
# 根据成组的平行线求中线
# ==================================================
def _get_mid_line_from_parallel(parallel_curves):
    ll_distance = []
    ll_vector = []
    for i in range(len(parallel_curves)):
        distance = DSCore.Math.Round(parallel_curves[i][0].DistanceTo(parallel_curves[i][1])) * 0.5
        vector = parallel_curves[i][0].NormalAtParameter(0.5)
        ll_distance.append(distance)
        ll_vector.append(vector)
    
    mid_curves = []
    for i in range(len(ll_vector)):
        cur = Geometry.Translate(parallel_curves[i][0], ll_vector[i], ll_distance[i])
        if DSCore.Math.Round(cur.DistanceTo(parallel_curves[i][1])) > ll_distance[i]:
            cur = Geometry.Translate(parallel_curves[i][0], ll_vector[i], -ll_distance[i])
        mid_curves.append(cur)
    return mid_curves

mid_curves  = [_get_mid_line_from_parallel(group) for group in parallel_curves_all]

# ==================================================
# 获取墙体类型
# ==================================================
wall_name = DSCore.List.Flatten(wall_name)
curves = DSCore.List.Flatten(mid_curves)

wall_curves = []
wall_type = []
for i in range(len(wall_name)):
    # 规避报错导致停止
    try:
        type = Revit.Elements.WallType.ByName(wall_name[i])
        curve = curves[i]
    except:
        continue
        # type = Revit.Elements.WallType.ByName(wall_name[i-1])
    wall_type.append(type)
    wall_curves.append(curve)
    



walls = []
for i in range(len(wall_curves)):
    wall = Revit.Elements.Wall.ByCurveAndLevels(wall_curves[i], level_start, level_end, wall_type[i])
    walls.append(wall)


OUT = walls
# ----------------------------------------

# group: 输出
# 说明 <双击此处编辑组说明>
watch_2 = Watch(python_script)  # graph output
