# Dynamo graph 3-批量生成结构柱.dyn (Dynamo 2.19.3.6394)
# packages: bimorphNodes 4.2.4

# group: 输入
# 说明 <双击此处编辑组说明>
选择链接CAD = DSModelElementSelection()  # 1 picked in the model; graph input
结构柱的CAD图层 = StringInput("COLUMN")  # graph input
结构柱标注的CAD图层 = StringInput("COLUMN_TEXT")  # graph input
柱子的Revit标高 = Levels("标高 1")  # graph input
柱子的Revit族名 = StringInput("混凝土 - 矩形 - 柱")  # graph input

curvesFromCADLayers = CAD.CurvesFromCADLayers(importInstance=选择链接CAD, layerNames=结构柱的CAD图层)
watch = Watch(curvesFromCADLayers.Curve)
fromLayers = CADTextData.FromLayers(importInstance=选择链接CAD, layerNames=结构柱标注的CAD图层)
originPoint = CADTextData.OriginPoint(cADTextData=fromLayers.CADTextData)
textValue = CADTextData.TextValue(cADTextData=fromLayers.CADTextData)
python_script = Python(IN[0]=watch, IN[1]=originPoint, IN[2]=textValue, IN[3]=柱子的Revit标高, IN[4]=柱子的Revit族名)  # CPython3
# ---------- python_script.python (159 lines) ----------
# -*- coding: utf-8 -*-
# 固定导入内容
# 1. 加载Python Standard和DesignScript库
import sys
import os
import math
import json
import clr

clr.AddReference('ProtoGeometry')  # Dynamo核心几何库
from Autodesk.DesignScript.Geometry import *
import Autodesk.DesignScript.Geometry as DynGeometry # 为避免冲突，使用DynGeometry.XX

clr.AddReference('DSCoreNodes')  # Dynamo核心基础库
import DSCore  # 为避免冲突，使用DSCore.List.XX

clr.AddReference('RevitNodes')  # Dynamo Revit专属节点库
import Revit   # 为避免冲突，使用Revit.Elements.XX
clr.ImportExtensions(Revit.Elements)
clr.ImportExtensions(Revit.GeometryConversion)

# 2. 导入Revit API
clr.AddReference('RevitAPI')
clr.AddReference('RevitAPIUI')
clr.AddReference("System.Collections")
import System
from Autodesk.Revit.DB import *
from Autodesk.Revit.UI import *
from System.Collections.Generic import *

# 3. 导入Revit管理服务
clr.AddReference("RevitServices")
import RevitServices
from RevitServices.Persistence import DocumentManager
from RevitServices.Transactions import TransactionManager

# 4. 全局文档对象
doc = DocumentManager.Instance.CurrentDBDocument
app = doc.Application
uiApp = DocumentManager.Instance.CurrentUIApplication
uidoc = uiApp.ActiveUIDocument

# 该节点的输入内容将存储为 IN 变量中的一个列表。
dataEnteringNode = IN

column_curves = DSCore.List.Flatten(IN[0])
origin_points = DSCore.List.Flatten(IN[1])
text_value = DSCore.List.Flatten(IN[2])
level = IN[3]
family_name = IN[4]

# ==================================================
# 成组相连的曲线
# ==================================================
def _group_curves(curves_list):
    """
    成组相连的线条，可用于多段线
    """
    curves = list(DSCore.List.Flatten(curves_list))
    ignore_distance = 0.1
    grouped_lines = []

    while curves:
        Shape = []
        Queue = [curves.pop()]
        while Queue:
            current_line = Queue.pop(0)
            Shape.append(current_line)
            # 临时存储要加入的曲线，避免循环内重复判断
            add_list = []
            for potential_match in curves:
                p1s = (potential_match.StartPoint, potential_match.EndPoint)
                p2s = (current_line.StartPoint, current_line.EndPoint)
                for p1 in p1s:
                    for p2 in p2s:
                        if p1.DistanceTo(p2) <= ignore_distance:
                            if potential_match not in add_list:
                                add_list.append(potential_match)
                            break
                    else:
                        continue
                    break
            # 批量加入队列
            for crv in add_list:
                if crv not in Queue:
                    Queue.append(crv)
            # 剔除已入队曲线
            curves = [c for c in curves if c not in Queue]
        grouped_lines.append(Shape)
    return grouped_lines

group_curves = _group_curves(column_curves)
poly_curves = [PolyCurve.ByJoinedCurves(curve) for curve in group_curves]


# ==================================================
# 根据文本，获取对应的族类型
# ==================================================
poly_curves_p = [p_curve.Points for p_curve in poly_curves]
polygon = [Polygon.ByPoints(row) for row in poly_curves_p]
mid_points = [Polygon.Center(poly) for poly in polygon]

text_distance = [[p.DistanceTo(op) for op in origin_points] for p in mid_points]
sorted_text_distance  = [DSCore.List.Sort(row) for row in text_distance]
shortest_dis = [dis[0] for dis in sorted_text_distance]

shortest_index = []
for i in range(len(mid_points)):
    idx = DSCore.List.FirstIndexOf(text_distance[i], shortest_dis[i])
    shortest_index.append(idx)

filter_text_value = [DSCore.List.GetItemAtIndex(text_value, index) for index in shortest_index]
points = mid_points

column_points = []
column_type = []
for i in range(len(mid_points)):
    # 规避报错导致停止
    try:
        type = Revit.Elements.FamilyType.ByFamilyNameAndTypeName(family_name, filter_text_value[i])
        point = points[i]
    except:
        continue
    column_type.append(type)
    column_points.append(point)

# OUT = column_points

columns = []
for i in range(len(mid_points)):
    column = Revit.Elements.FamilyInstance.ByPointAndLevel(column_type[i], column_points[i], level)
    columns.append(column)


# ==================================================
# 检查柱子是否需要旋转
# ==================================================
col_solids = DSCore.List.Flatten([col.Solids for col in columns], -1)
intersect_all = [[Geometry.Intersect(poly, col) for col in col_solids] for poly in polygon]
  
intersect_lines_0 = [[row for row in rows if len(row)>1] for rows in intersect_all]
intersect_lines = DSCore.List.Flatten(intersect_lines_0, 1)
curve_length = [[cur.Length for cur in row] for row in intersect_lines]
col_max_list = [DSCore.List.MaximumItem(row) for row in curve_length]

group_length = [[cur.Length for cur in row] for row in group_curves]
group_max_list = [DSCore.List.MaximumItem(row) for row in group_length]

mask = []
for i in range(len(col_max_list)):
    value = int(col_max_list[i]) == int(group_max_list[i])
    mask.append(value)

columns_unrotate = DSCore.List.FilterByBoolMask(columns, mask)["in"]
columns_for_rotate = DSCore.List.FilterByBoolMask(columns, mask)["out"]
columns_rotate = [Revit.Elements.FamilyInstance.SetRotation(col, 90) for col in columns_for_rotate]
final_columns = DSCore.List.Flatten([columns_unrotate, columns_rotate])

OUT = final_columns
# ----------------------------------------

# group: 输出
# 说明 <双击此处编辑组说明>
watch_2 = Watch(python_script)  # graph output
