# Dynamo graph 4-批量生成结构梁.dyn "批量生成结构梁" (Dynamo 2.19.3.6394)
# packages: bimorphNodes 4.2.4

# group: 输入
# 说明 <双击此处编辑组说明>
选择链接CAD = DSModelElementSelection()  # 1 picked in the model; graph input
结构梁的CAD图层 = StringInput("BEAM")  # graph input
结构梁标注的CAD图层 = StringInput("BEAM_TEXT")  # graph input
梁的Revit标高 = Levels("标高 1")  # graph input
梁的Revit族名 = StringInput("混凝土 - 矩形梁")  # graph input

curvesFromCADLayers = CAD.CurvesFromCADLayers(importInstance=选择链接CAD, layerNames=结构梁的CAD图层)
watch = Watch(curvesFromCADLayers.Curve)
fromLayers = CADTextData.FromLayers(importInstance=选择链接CAD, layerNames=结构梁标注的CAD图层)
originPoint = CADTextData.OriginPoint(cADTextData=fromLayers.CADTextData)
textValue = CADTextData.TextValue(cADTextData=fromLayers.CADTextData)
python_script = Python(IN[0]=watch, IN[1]=originPoint, IN[2]=textValue, IN[3]=梁的Revit标高, IN[4]=梁的Revit族名)  # CPython3
# ---------- python_script.python (171 lines) ----------
# -*- coding: utf-8 -*-
# 固定导入内容
# 1. 加载Python Standard和DesignScript库
import sys
import os
import math
import json
import clr

clr.AddReference('ProtoGeometry')  # Dynamo核心几何库
from Autodesk.DesignScript.Geometry import *
import Autodesk.DesignScript.Geometry as DynGeometry # 为避免冲突，使用DynGeometry.XX

clr.AddReference('DSCoreNodes')  # Dynamo核心基础库
import DSCore  # 为避免冲突，使用DSCore.List.XX

clr.AddReference('RevitNodes')  # Dynamo Revit专属节点库
import Revit   # 为避免冲突，使用Revit.Elements.XX
clr.ImportExtensions(Revit.Elements)
clr.ImportExtensions(Revit.GeometryConversion)

# 2. 导入Revit API
clr.AddReference('RevitAPI')
clr.AddReference('RevitAPIUI')
clr.AddReference("System.Collections")
import System
from Autodesk.Revit.DB import *
from Autodesk.Revit.UI import *
from System.Collections.Generic import *

# 3. 导入Revit管理服务
clr.AddReference("RevitServices")
import RevitServices
from RevitServices.Persistence import DocumentManager
from RevitServices.Transactions import TransactionManager

# 4. 全局文档对象
doc = DocumentManager.Instance.CurrentDBDocument
app = doc.Application
uiApp = DocumentManager.Instance.CurrentUIApplication
uidoc = uiApp.ActiveUIDocument

# 该节点的输入内容将存储为 IN 变量中的一个列表。
dataEnteringNode = IN

beam_curves = DSCore.List.Flatten(IN[0])
origin_points = DSCore.List.Flatten(IN[1])
text_value = DSCore.List.Flatten(IN[2])
level = IN[3]
family_name = IN[4]


# ==================================================
# 成组两条平行线
# ==================================================
def _parallel_curves(curves): 
    """
    #成组两条平行线。
    """
    if len(curves) < 2:
        return []
    
    mid_points = [c.PointAtParameter(0.5) for c in curves]
    distance = [[p.DistanceTo(q) for q in mid_points] for p in mid_points]
    sorted_distance = [DSCore.List.Sort(row) for row in distance]
    match_distance = [row[1] for row in sorted_distance] 

    match_index = []
    for i in range(len(distance)):
        idx = DSCore.List.FirstIndexOf(distance[i], match_distance[i])
        match_index.append(idx)
    
    filter_curves = [DSCore.List.GetItemAtIndex(curves, index) for index in match_index]
    
    curves_list = []
    seen_pairs = set()  # 新增：记录已处理的配对索引，避免重复
    
    for i in range(len(curves)):
        j = match_index[i]
        # 关键修复：只处理 i < j 的情况，确保每对只创建一次
        if i < j and (i, j) not in seen_pairs:
            keys = [curves[i].Length, filter_curves[i].Length]
            lst = [curves[i], filter_curves[i]]
            sorted_lst = DSCore.List.SortByKey(lst, keys)["sortedList"]
            curves_list.append(sorted_lst)
            seen_pairs.add((i, j))  # 记录已处理配对
    
    parallel_curves = DSCore.List.UniqueItems(curves_list)
    return parallel_curves


parallel_curves_original = _parallel_curves(beam_curves)

# OUT = parallel_curves_original


# ==================================================
# 二次筛选，剔除非平行线
# ==================================================
parallel_mask = []

for group in parallel_curves_original:
    line_vector1 = group[0].Direction
    line_vector2 = group[1].Direction
    mask = line_vector1.IsParallel(line_vector2)
    parallel_mask.append(mask)

parallel_curves = DSCore.List.FilterByBoolMask(parallel_curves_original, parallel_mask)["in"]

# OUT = parallel_curves


# ==================================================
# 根据成组的平行线求中线
# ==================================================
def _get_mid_line_from_parallel(parallel_curves):
    ll_distance = []
    ll_vector = []
    for i in range(len(parallel_curves)):
        distance = DSCore.Math.Round(parallel_curves[i][0].DistanceTo(parallel_curves[i][1])) * 0.5
        vector = parallel_curves[i][0].NormalAtParameter(0.5)
        ll_distance.append(distance)
        ll_vector.append(vector)
    
    mid_curves = []
    for i in range(len(ll_vector)):
        cur = Geometry.Translate(parallel_curves[i][0], ll_vector[i], ll_distance[i])
        if DSCore.Math.Round(cur.DistanceTo(parallel_curves[i][1])) > ll_distance[i]:
            cur = Geometry.Translate(parallel_curves[i][0], ll_vector[i], -ll_distance[i])
        mid_curves.append(cur)
    return mid_curves

mid_curves  = _get_mid_line_from_parallel(parallel_curves)

# OUT = mid_curves


# ==================================================
# 根据文本，获取对应的族类型
# ==================================================
mid_curves_p = [item.PointAtParameter(0.5) for item in mid_curves]
text_distance = [[p.DistanceTo(op) for op in origin_points] for p in mid_curves_p]
sorted_text_distance  = [DSCore.List.Sort(row) for row in text_distance]
shortest_dis = [dis[0] for dis in sorted_text_distance]

shortest_index = []
for i in range(len(mid_curves)):
    idx = DSCore.List.FirstIndexOf(text_distance[i], shortest_dis[i])
    shortest_index.append(idx)

filter_text_value = [DSCore.List.GetItemAtIndex(text_value, index) for index in shortest_index]
curves = mid_curves

beam_curves = []
beam_type = []
for i in range(len(mid_curves)):
    # 规避报错导致停止
    try:
        type = Revit.Elements.FamilyType.ByFamilyNameAndTypeName(family_name, filter_text_value[i])
        curve = curves[i]
    except:
        continue
    beam_type.append(type)
    beam_curves.append(curve)

beams = []
for i in range(len(beam_curves)):
    beam = Revit.Elements.StructuralFraming.BeamByCurve(beam_curves[i], level, beam_type[i])
    beams.append(beam)

OUT = beams
# ----------------------------------------

# group: 输出
# 说明 <双击此处编辑组说明>
watch_2 = Watch(python_script)  # graph output
