# Dynamo graph cad.dyn (Dynamo 2.19.3.6394)
# packages: bimorphNodes 4.2.4

curvesFromCADLayers = CAD.CurvesFromCADLayers()  # unwired: importInstance
code_block = CodeBlock { "BM1"; }
element_classes = ElementTypes("ImportInstance")
all_elements_of_class = ElementsOfType(element_class=element_classes)
python_script = Python(IN[0]=all_elements_of_class)  # CPython3; unwired: IN[1], IN[2], IN[3]
# ---------- python_script.python (309 lines) ----------
# 1. 加载Python Standard和DesignScript库
import sys
import os
import math
import json
import clr

clr.AddReference('ProtoGeometry')  # Dynamo核心几何库
from Autodesk.DesignScript.Geometry import *

clr.AddReference('DSCoreNodes')  # Dynamo核心基础库
import DSCore  # 为避免冲突，使用DSCore.List.XX

clr.AddReference('RevitNodes')  # Dynamo Revit专属节点库
import Revit   # 为避免冲突，使用Revit.Elements.XX
clr.ImportExtensions(Revit.Elements)
clr.ImportExtensions(Revit.GeometryConversion)

# 2. 导入Revit API
clr.AddReference('RevitAPI')
clr.AddReference('RevitAPIUI')
clr.AddReference("System.Collections")
import System
from Autodesk.Revit.DB import *
from Autodesk.Revit.UI import *
from System.Collections.Generic import *

# 3. 导入Revit管理服务
clr.AddReference("RevitServices")
import RevitServices
from RevitServices.Persistence import DocumentManager
from RevitServices.Transactions import TransactionManager

# 4. 全局文档对象
doc = DocumentManager.Instance.CurrentDBDocument
app = doc.Application
uiApp = DocumentManager.Instance.CurrentUIApplication
uidoc = uiApp.ActiveUIDocument


# 必须和Packages下的包文件夹名完全一致（大小写敏感）
PACKAGE_NAME = "ArchAI"
OUT = ""  # 初始化OUT，避免未定义

# ===================== 1. 自动定位节点包的根路径 =====================
# 获取APPDATA路径
appdata = os.environ.get("APPDATA")
# 定位Dynamo Revit根目录
dynamo_root = os.path.join(appdata, "Dynamo", "Dynamo Revit")
if not os.path.isdir(dynamo_root):
    print(f"Dynamo根目录不存在 - {dynamo_root}")
# 遍历版本目录，查找包路径
lib_path = None
try:
    for version_dir in os.listdir(dynamo_root):
        version_path = os.path.join(dynamo_root, version_dir)
        # 跳过非目录
        if not os.path.isdir(version_path):
            continue
        temp_lib = os.path.join(version_path, "Packages", PACKAGE_NAME)
        # 找到第一个有效路径就停止
        if os.path.exists(temp_lib):
            lib_path = temp_lib
            break
except OSError as e:
    print(f"遍历目录时出错：{str(e)}")

def get_package_lib_path():
    if lib_path not in sys.path:
        sys.path.append(lib_path)
    return lib_path, f"lib路径：{lib_path}" if lib_path else "未找到包的节点包目录"

# 初始化路径
get_package_lib_path()


# ==============================================
# 加载 Bimorph 所有 DLL
# ==============================================
lib_path, path_msg = get_package_lib_path()
dll_dir = os.path.join(lib_path, "bin")
sys.path.append(dll_dir)

dlls = [
    "BimorphNodes.dll",
    "BimorphNodes.Core.dll",
    "BimorphNodes.Geometry.dll",
    "BimorphNodes.Compatibility.dll",
    "netDxf.netstandard.dll"
]

for dll in dlls:
    path = System.IO.Path.Combine(dll_dir, dll)
    System.Reflection.Assembly.LoadFrom(path)
       


# ==============================================
# Python列表 → .NET List<string>
# 使用 BimorphNodes 节点包中节点
# ==============================================
def _to_net(py_list):
    """将Python列表转换为.NET字符串泛型列表"""
    net_list = List[System.String]()
    for item in py_list:
        net_list.Add(str(item))
    return net_list



def _cad_curves_from_cad_layers(layer_names, create_model_curves = False, line_style_map = None):
    """
    根据链接CAD文件，批量生成结构框架（结构柱或结构梁）
    :param layer_names: 链接CAD文件中结构框架的图层名称列表
    :param create_model_curves: 默认不创建模型线条
    :param line_style_map: 默认不映射线条类型
    :return: 字典，包含"Curve[][]" 与 "layerKeys[]"
    使用 BimorphNodes 节点包中节点，默认选择第一个链接CAD文件
    """
    collector = FilteredElementCollector(doc).OfClass(ImportInstance).ToElements()
    import_instance = collector[0].ToDSType(True)
    ln = _to_net(layer_names)
    lsm = _to_net(line_style_map or [])
    
    # ==============================================
    # 查找 CAD 类
    # ==============================================
    Cad = None
    for asm in System.AppDomain.CurrentDomain.GetAssemblies():
        if "Bimorph" in asm.GetName().Name:
            for t in asm.GetTypes():
                if t.Name == "CAD":
                    Cad = t
            if Cad: break
            
    # ==============================================
    # 查找目标方法
    # ==============================================
    method = None
    if Cad:
        for m in Cad.GetMethods():
            if "CurvesFromCADLayers" in m.Name:
                method = m
                break
    
    # ==============================================
    # 使用方法
    # ==============================================
    try:
        # 4个参数：ImportInstance, LayerNames, create_model_curves, line_style_map
        param_list = [import_instance, ln, create_model_curves, lsm]
        # 调用静态方法
        result = method.Invoke(None, param_list)
        return result
    
    except Exception as e:
        return f"错误：{str(e)}"
        
        
def _cad_text_data_from_layers(layer_names = None):
    """
    根据链接CAD文件，批量生成结构框架（结构柱或结构梁）
    :param layer_names: 链接CAD文件中文字的图层名称列表
    :return: 字典，包含"layerKeys[]"与"CADTextData[][]" 
    使用 BimorphNodes 节点包中节点，默认选择第一个链接CAD文件
    """
    collector = FilteredElementCollector(doc).OfClass(ImportInstance).ToElements()
    import_instance = collector[0].ToDSType(True)
    ln = _to_net(layer_names or [])
    
    # ==============================================
    # 查找 CADTextData 类
    # ==============================================
    CadTextData = None
    for asm in System.AppDomain.CurrentDomain.GetAssemblies():
        if "Bimorph" in asm.GetName().Name:
            for t in asm.GetTypes():
                if t.Name == "CADTextData":
                    CadTextData = t
            if CadTextData: break
            
    # ==============================================
    # 查找目标方法
    # ==============================================
    method = None
    if CadTextData:
        for m in CadTextData.GetMethods():
            if "FromLayers" in m.Name:
                method = m
                break
    
    # ==============================================
    # 使用方法
    # ==============================================
    try:
        # 2个参数：ImportInstance, LayerNames
        param_list = [import_instance, ln]
        # 调用静态方法
        result = method.Invoke(None, param_list)
        return result
    
    except Exception as e:
        return f"错误：{str(e)}"
        
        
def _cad_text_data_origin_point(cad_text_data):
    """
    根据链接CAD文件，批量生成结构框架（结构柱或结构梁）
    :param cad_text_data: 由函数_cad_text_data_from_layers()返回，使用"CADTextData[][]"键值
    :return: 点列表
    使用 BimorphNodes 节点包中节点
    """
    
    # ==============================================
    # 查找 CADTextData 类
    # ==============================================
    CadTextData = None
    for asm in System.AppDomain.CurrentDomain.GetAssemblies():
        if "Bimorph" in asm.GetName().Name:
            for t in asm.GetTypes():
                if t.Name == "CADTextData":
                    CadTextData = t
            if CadTextData: break
            
    # ==============================================
    # 查找目标方法
    # ==============================================
    method = None
    if CadTextData:
        for m in CadTextData.GetMethods():
            if "OriginPoint" in m.Name:
                method = m
                break
    
    # ==============================================
    # 使用方法
    # ==============================================
    try:
        # 单个对象
        if not isinstance(cad_text_data, list):
            return method.Invoke(cad_text_data, [])
        # 二维列表
        elif not isinstance(cad_text_data[0], list):
            res = []
            for row in cad_text_data:
                row_res = [method.Invoke(item, []) for item in row]
                res.append(row_res)
            return res
        # 一维列表
        else:
            return [method.Invoke(item, []) for item in cad_text_data]
    
    except Exception as e:
        return f"错误：{str(e)}"
        
def _cad_text_data_text_value(cad_text_data):
    """
    根据链接CAD文件，批量生成结构框架（结构柱或结构梁）
    :param cad_text_data: 由函数_cad_text_data_from_layers()返回，使用"CADTextData[][]"键值
    :return: 点列表
    使用 BimorphNodes 节点包中节点
    """
    
    # ==============================================
    # 查找 CADTextData 类
    # ==============================================
    CadTextData = None
    for asm in System.AppDomain.CurrentDomain.GetAssemblies():
        if "Bimorph" in asm.GetName().Name:
            for t in asm.GetTypes():
                if t.Name == "CADTextData":
                    CadTextData = t
            if CadTextData: break
            
    # ==============================================
    # 查找目标方法
    # ==============================================
    method = None
    if CadTextData:
        for m in CadTextData.GetMethods():
            if "TextValue" in m.Name:
                method = m
                break
    
    # ==============================================
    # 使用方法
    # ==============================================
    try:
        # 单个对象
        if not isinstance(cad_text_data, list):
            return method.Invoke(cad_text_data, [])
        # 二维列表
        elif not isinstance(cad_text_data[0], list):
            res = []
            for row in cad_text_data:
                row_res = [method.Invoke(item, []) for item in row]
                res.append(row_res)
            return res
        # 一维列表
        else:
            return [method.Invoke(item, []) for item in cad_text_data]
    
    except Exception as e:
        return f"错误：{str(e)}"

cad_text_data = _cad_text_data_from_layers()["CADTextData[][]"]
OUT = _cad_text_data_text_value(cad_text_data)

#OUT = cad_text_data
# ----------------------------------------
fromLayers = CADTextData.FromLayers()  # unwired: importInstance
textValue = CADTextData.TextValue()  # unwired: cADTextData
code_block_2 = CodeBlock { point1 = CADTextData.OriginPoint(t1); }  # unwired: t1
